# Grasshopper definition 018_rotations.ghx (Grasshopper 1.0.7)

box = GhPythonScript()  # -> frame, box
# ---------- box: Python ----------
from compas.geometry import Frame
from compas.geometry import Box

width, length, height = 1, 1, 1
box = Box(Frame.worldXY(), width, length, height)

frame = box.frame
# ---------- end box ----------

# ----
# Euler angles
alpha = Slider(0, range=-180..180)
beta = Slider(0, range=-180..180)
gamma = Slider(0, range=-180..180)
rad = Radians(Degrees=alpha)
rad_2 = Radians(Degrees=beta)
rad_3 = Radians(Degrees=gamma)
list = ValueList({"xyz", "xyx"}, selected="xyz")
euler_angles = GhPythonScript(alpha=rad, beta=rad_2, gamma=rad_3, static=Toggle(False), axes=list)  # -> R
# ---------- euler_angles: Python ----------
from compas.geometry import Rotation

R = Rotation.from_euler_angles([alpha, beta, gamma], static, axes)
# ---------- end euler_angles ----------
py = GhPythonScript(box=box.box, R=euler_angles)  # -> out, frame_transformed, box_transformed
# ---------- py: Python ----------
from compas.geometry import Rotation

box_transformed = box.transformed(R)
frame_transformed = box_transformed.frame

print("axis and angle", Rotation.from_frame(box_transformed.frame).axis_and_angle)
print("axis_angle_vector", box_transformed.frame.axis_angle_vector)
print("quaternion", box_transformed.frame.quaternion)
# ---------- end py ----------
draw = GhPythonScript(box=py.box_transformed)  # -> B
# ---------- draw: Python ----------
from compas.artists import Artist
B = Artist(box).draw()
# ---------- end draw ----------
panel = Panel(py.out)

draw_2 = GhPythonScript(box=box.box)  # -> B; same code as draw
draw_3 = GhPythonScript(frames=box.frame, scale=Slider(1, range=0..1))  # -> P, V, C, W; inputs frames: list
# ---------- draw_3: Python ----------
from System.Drawing import Color
from compas_ghpython.utilities import draw_frame

red = Color.FromArgb(255, 0, 0)
green = Color.FromArgb(0, 255, 0)
blue = Color.FromArgb(0, 0, 255)

P = []
V = []
C = []

scale = float(scale)

for frame in frames:
    if not frame:
        continue
    plane = draw_frame(frame)
    P += [plane.Origin] * 3
    V.append(plane.XAxis * scale)
    V.append(plane.YAxis * scale)
    V.append(plane.ZAxis * scale)
    C += [red, green, blue]

W = 3
# ---------- end draw_3 ----------
vdisex = VectorDisplayEx(Point=draw_3.P, Vector=draw_3.V, Colour=draw_3.C, Width=draw_3.W)
draw_4 = GhPythonScript(frames=py.frame_transformed, scale=Slider(1, range=0..1))  # -> P, V, C, W; inputs frames: list; same code as draw_3
vdisex_2 = VectorDisplayEx(Point=draw_4.P, Vector=draw_4.V, Colour=draw_4.C, Width=draw_4.W)
