# Grasshopper definition 601_assembly_design.ghx (Grasshopper 1.0.7)

height = Slider(0.02, range=0.02..0.1)
part = GhPythonScript(width=Slider(0.06, range=0.02..0.1), depth=Slider(0.03, range=0.02..0.1), height=height)  # -> a, part
# ---------- part: Python ----------
from compas.geometry import Box
from compas.artists import Artist

part = Box.from_diagonal([(width / -2., depth / -2., 0), (width / 2., depth / 2., height)])
a = Artist(part).draw()
# ---------- end part ----------
pt = Point([<point referenced from the Rhino model> x4])
assembly = GhPythonScript(points=pt, rows=Slider(1, range=1..20), part_shape=part.part)  # -> frames, curve, bricks, wall; inputs points: list
# ---------- assembly: Python ----------
from compas.artists import Artist
from compas.datastructures import Assembly
from compas.datastructures import Part
from compas.geometry import Box
from compas.geometry import Polyhedron
from compas.geometry import Frame
from compas.geometry import Transformation
from compas.geometry import Translation
from compas.geometry import NurbsCurve
from compas_rhino.conversions import RhinoPoint

# Create Wall as Assembly instance
wall = Assembly("exercise-wall")

# Create wall curve
points = [RhinoPoint.from_guid(p).to_compas() for p in points]
curve = NurbsCurve.from_interpolation(points)

HGAP = 0.005
VGAP = 0.002
divisions = curve.divide_by_length(part_shape.width + HGAP)

# Create brick frames
frames = []
key = 0
for row in range(int(rows)):
    Trow = Translation.from_vector((0, 0, part_shape.height / 2. + (part_shape.height + VGAP) * row))

    for div, i in zip(divisions, range(len(divisions))):
        point = curve.point_at(div)
        xaxis = curve.tangent_at(div)
        yaxis = xaxis.cross((0, 0, 1))
        frame = Frame(point, xaxis, yaxis)

        # Create bricks as parts
        width, height, depth = part_shape.width, part_shape.height, part_shape.depth
        brick_type = 'full'
        if row % 2 == 1 and i % len(divisions) == 0:
            brick_type = 'half'
        if row % 2 == 0 and i % (len(divisions)) == len(divisions)-1:
            brick_type = 'half'

        if brick_type == 'half':
            width = width / 2.
            xoffset = width / 2.
        else:
            xoffset = width / 2. if row % 2 == 0 else 0

        shape = Box.from_width_height_depth(width, height, depth)
        shape = Polyhedron(*shape.to_vertices_and_faces())

        Tb = Translation.from_vector((xoffset, 0, 0))
        Tf = Transformation.from_frame(frame)
        frame = Frame.from_transformation(Trow * Tf * Tb)
        frames.append(frame)

        part = Part(frame=frame, shape=shape)
        wall.add_part(part, key=str(key))
        key += 1


frames = [Artist(f).draw() for f in frames]
curve = Artist(curve).draw()
bricks = [Artist(brick.geometry).draw() for brick in wall.parts()]
# ---------- end assembly ----------
geo = Geometry(assembly.frames)
geo_2 = Geometry(assembly.curve)
geo_3 = Geometry(assembly.bricks)
py = GhPythonScript()  # -> PATH
# ---------- py: Python ----------
import os

filename = ghenv.Component.OnPingDocument().FilePath
PATH = os.path.join(os.path.dirname(filename), '601_assembly_design.json')
# ---------- end py ----------
to_json = ToJSON(data=assembly.wall, filepath=py, pretty=Toggle(True))  # -> json; inputs pretty: Boolean
#   port data: COMPAS data objects to serialize.
#   port filepath: File path where to store the JSON file. If empty, it will not store to disk but instead return the JSON string.
#   port pretty: If True, JSON data will be formatted with indentation and key sorting.
#   port json: JSON file path or JSON string.
# ---------- to_json: Python ----------
"""
Serializes COMPAS objects to JSON.
"""
from ghpythonlib.componentbase import executingcomponent as component

import compas


class CompasInfo(component):
    def RunScript(self, data, filepath, pretty):
        json = filepath

        if filepath:
            compas.json_dump(data, filepath, pretty)
        else:
            json = compas.json_dumps(data, pretty)

        return json
# ---------- end to_json ----------
